# Dynamo graph CreateSectionBoxesOnDupViews_DSUG_v2.dyn (Dynamo 1.3.2.2480)

# group: REVIT ACTION
# note: USE:
# CREATE ELEMENTS IN THE REVIT ENVIRONMENT
# note: CREATION

# group: ANNOTATION
# note: USE:
# FOR COMMENTS
# note: ANNOTATION

# group: INFO
# note: CREATED BY: AT
# MODIFIED BY: AT
# STARTING DATE: 06/03/2018
# FINISHING DATE: 09/03/2018
# DYNAMO VERSION: <Dynamo 1.3.0>
# PACKAGES USED:
# - Archi-lab_Grimshaw 2018.0.8
# - Steamnodes 1.2.3
# - Rhythm 2017.6.6
# - Data-Shapes 2017.6.7
# - Clockwork 1.0.3
# PROJECT SPECIFIC:
# NO

# group: DYNAMO ACTION
# note: USE:
# CREATE ELEMENTS IN THE DYNAMO ENVIRONMENT
# note: CREATION

# group: INSTRUCTIONS
# note: SETUP DISCIPLINES, COMPANY CODES AND MODEL NUMBER/COSE IN THE GROUP:
# INPUT - Disciplines & Companies
# IMPORTANT!!!!
# MAKE SURE THE NUMBER OF DISCIPLINES MATCHES WITH THE NUMBER OF COMPANIES (EVEN IF THERE ARE REPETITIONS)

# group: MODIFY PARAMETERS
# note: USE:
# WHEN MODIFYING PARAMETERS OF REVIT ELEMENTS
# note: PARAMETERS

# group: GET PARAMETERS
# note: USE:
# WHEN QUERYING PARAMETERS OF REVIT ELEMENTS
# note: PARAMETERS

# group: WRITE
# note: USE:
# WRITE DATA IN EXTERNAL FILES SUCH AS EXCEL, CSV, NOTES, WORD, ETC.
# note: OUTPUT

# group: TEMPORARY
# note: USE:
# WIP TEMPORAY PARTS THAT HELP IN DEVELOPING
# THE SCRIPT BUT ARE NOT PART OF THE FINAL WORKFLOW
# note: WIP

# group: ELEMENTS COLLECTOR
# note: USE:
# NODES THAT REFERENCE/COLLECT REVIT ELEMENTS
# INSIDE OF DYNAMO
# note: COLLECTORS

# group: U.I.
# note: USE:
# USER INPUTS TO BE FILLED IN TO RUN THE SCRIPT OR WHAT THE USER WANTS TO SEE
# note: USER INTERFACE

# group: BEST PRACTICE GUIDE
# note: GUIDE
# 1. DIVIDE THE DYNAMO DEFINITION INTO THE USER INTERFACE AND THE BACK-END
# 2. BUILD THE DEFINITION WITH SMALL BLOCKS
# 3. COLOR-CODE BLOCKS ACCORDING TO THE TEMPLATE
# 4. ALWAYS WRITE CONCISE INSTRUCTIONS ON HOW TO RUN THE SCRIPT
# 5. ALWAYS COMPILE INFO
# 6. GROUPS NAMING CONVENTION:
# <USE>_<AFFECTED ELEMENTS/GEOMETRY>

# group: Get model Extensions
default3DView = Custom[Document.Default3DView]()  # Returns the default 3D view of the current model (if there is such a view)
code_block = CodeBlock { "Section Box"; 1; }
setParameterByName = Element.SetParameterByName(element=default3DView, parameterName=code_block.out0, value=code_block.out1)
getSectionBox = Python(IN[0]=setParameterByName)
# ---------- getSectionBox.python (8 lines) ----------
import clr
clr.AddReference('RevitNodes')
import Revit
clr.ImportExtensions(Revit.GeometryConversion)

sectionbox = UnwrapElement(IN[0]).GetSectionBox()

OUT = sectionbox.ToProtoType(True)
# ----------------------------------------
minPoint = BoundingBox.MinPoint(getSectionBox)
deconstructPoint = Geometry.Points.DeconstructPoint(minPoint)
maxPoint = BoundingBox.MaxPoint(getSectionBox)
deconstructPoint_2 = Geometry.Points.DeconstructPoint(maxPoint)

# group: Get Levels
boolean = BoolSelector(true)
level_element_collector = Custom[Level Element Collector](RunMe=boolean)  # This collects data for all of the Level elements in the model. Similar to the node on Lunchbox, but this one uses all O.O.B. nodes.

# group: Sort Levels by Elevation
elevation = Level.Elevation(level_element_collector.Element)
sortByKey = List.SortByKey(list=level_element_collector.Element, keys=elevation)

# group: UI - Views Selection
code_block_2 = CodeBlock { "Select Levels"; "Cancel"; }
code_block_3 = CodeBlock { "Select the levels that will host the section boxes"; }
name = Level.Name(sortByKey.sorted_list)
code_block_4 = CodeBlock(levName=name, levElevation=sortByKey.sorted_keys) { "Level Name: " + levName + " - Elevation: " + levElevation; true; false; }
ui_listview_data = Custom[UI.Listview Data](InputName=code_block_3, Keys=code_block_4.out0, Values=sortByKey.sorted_list, ShowElementCount_optionnal=code_block_4.out1, SortItems=code_block_4.out2)  # Create data for ListView input in UI.MultiInputForm ++ . Check out www.data-shapes.net for more infos.
code_block_5 = CodeBlock { true; 1000; }
ui_multipleinputform = Custom[UI.MultipleInputForm ++](ButtonText_optional=code_block_2.out0, Inputs=ui_listview_data, Toggle=code_block_5.out0, CancelButtonText_optional=code_block_2.out1, MaxHeight_optional=code_block_5.out1, Width_optional=code_block_5.out1)  # Create a form with multiple inputs. see www.data-shapes.net for tutorials and infos!
flatten = Flatten(ui_multipleinputform.User_Inputs)
watch = Watch(ui_multipleinputform.User_Inputs)

# group: INPUT - Disciplines & Companies
disciplines_code = CodeBlock()
# ---------- disciplines_code.designscript (6 lines) ----------
{"AR",
"EL",
"FR",
"HY",
"ME",
"ST"};
# ----------------------------------------
companies_code = CodeBlock()
# ---------- companies_code.designscript (6 lines) ----------
{"ABC",
"DEF",
"GHI",
"LMN",
"OPQ",
"RST"};
# ----------------------------------------
modelnumber_code = CodeBlock { "001"; }

# group: Duplicate 3D Views w/ Naming and Structure
name_2 = Level.Name(flatten)
code_block_6 = CodeBlock(levName=name_2) { levName + "-"; }
code_block_7 = CodeBlock(discCode=disciplines_code, compCode=companies_code, modNumber=modelnumber_code) { "DSUG_ " + discCode + "-" + compCode + "-" + modNumber + ".NWC"; }
add = code_block_6 + code_block_7  # lacing=CrossProduct
code_block_8 = CodeBlock { "Duplicate"; }
duplicate = archilab.Revit.Views.View.Duplicate(default3DView, add, code_block_8)
topLevelStr = CodeBlock { "Navis"; "COORDINATION"; }
setParameterByName_2 = Element.SetParameterByName(element=duplicate, parameterName=topLevelStr.out1, value=topLevelStr.out0)
midLevelStr = CodeBlock { "20180410"; "NAVISWORKS EXPORT VIEWS"; }
setParameterByName_3 = Element.SetParameterByName(element=setParameterByName_2, parameterName=midLevelStr.out1, value=midLevelStr.out0)
lowLevelStr = CodeBlock(levName=name_2) { "DSUG_3D_VIEWS"; levName; }
setParameterByName_4 = Element.SetParameterByName(element=setParameterByName_3, parameterName=lowLevelStr.out0, value=lowLevelStr.levName)

# group: PRESET Top - Bottom Displacement
code_block_9 = CodeBlock { 100000; }

# group: Min
elevation_2 = Level.Elevation(flatten)
code_block_10 = CodeBlock { 0; }
getItemAtIndex = List.GetItemAtIndex(list=elevation_2, index=code_block_10)
code_block_11 = CodeBlock(min=getItemAtIndex, x=code_block_9) { min - x; }
replaceItemAtIndex = List.ReplaceItemAtIndex(list=elevation_2, index=code_block_10, item=code_block_11)

# group: Get Levels Above
code_block_12 = CodeBlock { -1; }
shiftIndices = List.ShiftIndices(list=flatten, amount=code_block_12)
code_block_13 = CodeBlock(lst=shiftIndices) { Count(lst)-1; }
removeItemAtIndex = List.RemoveItemAtIndex(list=shiftIndices, indices=code_block_13)

# group: Max
elevation_3 = Level.Elevation(removeItemAtIndex)
code_block_14 = CodeBlock(nLst=elevation_3) { Count(nLst)-1; }
getItemAtIndex_2 = List.GetItemAtIndex(list=elevation_3, index=code_block_14)
code_block_15 = CodeBlock(max=getItemAtIndex_2, x=code_block_9) { max + x; }
addItemToEnd = List.AddItemToEnd(item=code_block_15, list=elevation_3)

# group: Create Section Boxes in 3D views
byCoordinates = Point.ByCoordinates(x=deconstructPoint.out0, y=deconstructPoint.out1, z=replaceItemAtIndex@L1)
byCoordinates_2 = Point.ByCoordinates(x=deconstructPoint_2.out0, y=deconstructPoint_2.out1, z=addItemToEnd@L1)
byCorners = BoundingBox.ByCorners(min=byCoordinates, max=byCoordinates_2)
setSectionBox = Custom[View3D.SetSectionBox](view3D=setParameterByName_4@L2, boundingBox=byCorners@L1)  # This will set a views section box giving a bounding box.

# group: Assign View Templates
code_block_16 = CodeBlock { "DSUG_3D_Navisworks_"; }
add_2 = code_block_16 + disciplines_code
count = Count(duplicate@L3)
ofRepeatedItem = List.OfRepeatedItem(item=add_2, amount=count)
applyViewTemplate = Custom[View.ApplyViewTemplate](Views=setParameterByName_4@L1, View_Template_Name=ofRepeatedItem@L1)  # Applies a view template to any given view(s). Supply a string with a view template name.
