# Dynamo graph 190903_Script - Model cleaner.dyn (Dynamo 2.0.3.8104)

code_block = CodeBlock { "View Templates"; "Filters"; "Line Patterns"; "Purged?"; }

# group: Initial UI Inputs - not covered in the session (data shapes)
code_block_2 = CodeBlock { "Remove unused:"; }
code_block_3 = CodeBlock { "View Templates?"; "Filters?"; "Line Patterns"; "Purge Unused?"; true; }
ui_boolean_input = Custom[UI.Boolean input](DefaultValue=code_block_3.out4, SideText=code_block_3.out0)  # Creates a boolean input for UI.MultipleInputForm ++ . Check out www.data-shapes.net for more infos!
ui_boolean_input_2 = Custom[UI.Boolean input](DefaultValue=code_block_3.out4, SideText=code_block_3.out1)
ui_boolean_input_3 = Custom[UI.Boolean input](DefaultValue=code_block_3.out4, SideText=code_block_3.out2)
ui_boolean_input_4 = Custom[UI.Boolean input](DefaultValue=code_block_3.out4, SideText=code_block_3.out3)
list_create = List.Create(item0=ui_boolean_input, item1=ui_boolean_input_2, item2=ui_boolean_input_3, item3=ui_boolean_input_4)
ui_inputgroup_data = Custom[UI.InputGroup Data](GroupTitle=code_block_2, Inputs=list_create)  # Creates a group of inputs for UI.MultipleInputForm ++ . Check out www.data-shapes.net for more infos !
code_block_4 = CodeBlock { "Delete all:"; }
code_block_5 = CodeBlock { "Working Views?"; "Legends?"; "Schedules?"; true; }
ui_boolean_input_5 = Custom[UI.Boolean input](DefaultValue=code_block_5.out3, SideText=code_block_5.out0)
ui_boolean_input_6 = Custom[UI.Boolean input](DefaultValue=code_block_5.out3, SideText=code_block_5.out1)
ui_boolean_input_7 = Custom[UI.Boolean input](DefaultValue=code_block_5.out3, SideText=code_block_5.out2)
list_create_2 = List.Create(item0=ui_boolean_input_5, item1=ui_boolean_input_6, item2=ui_boolean_input_7)
ui_inputgroup_data_2 = Custom[UI.InputGroup Data](GroupTitle=code_block_4, Inputs=list_create_2)

# group: UI - not covered in the session (data shapes)
code_block_6 = CodeBlock { "Model Stripper"; "Run script"; "Cancel"; }
file_path = Filename(".\logo.jpg")
list_create_3 = List.Create(item0=ui_inputgroup_data, item1=ui_inputgroup_data_2)
boolean = BoolSelector(true)
code_block_7 = CodeBlock { 1000; 300; }
ui_multipleinputform = Custom[UI.MultipleInputForm ++](Description_optional=code_block_6.out0, Logo_optional=file_path, ButtonText_optional=code_block_6.out1, Inputs=list_create_3, Toggle=boolean, CancelButtonText_optional=code_block_6.out2, MaxHeight_optional=code_block_7.out0, Width_optional=code_block_7.out1)  # Create a form with multiple inputs. see www.data-shapes.net for tutorials and infos!
code_block_8 = CodeBlock(list=ui_multipleinputform.User_Inputs)
# ---------- code_block_8.designscript (7 lines) ----------
out_VTemp = list[0];
out_Filtr = list[1];
out_LPatn = list[2];
out_Purge = list[3];
out_WorkV = list[4];
out_Legen = list[5];
out_Sched = list[6];
# ----------------------------------------

# group: True = delete unused view templates. Note that we are using an 'If' to determine if we get the 'set toggle to true' result when delete is false, then processing that into a '0', otherwise we will get a countable list. If we counted the 'false' list, we could count 1 item, which isn't true - it's deleting 0 templates in this case.
# note: Modelical
delete_unused_viewtemplates = Custom[Delete Unused ViewTemplates](Toggle=code_block_8.out_VTemp)  # Delete all unused ViewTemplates in your file, except for 3D view templates, as they cannot be converted to work with Dynamo yet.
code_block_9 = CodeBlock(x=delete_unused_viewtemplates) { x[0]; "Set Toggle"; true; }
contains = String.Contains(str=code_block_9.out0, searchFor=code_block_9.out1, ignoreCase=code_block_9.out2)
code_block_10 = CodeBlock { 0; }
count = List.Count(list=delete_unused_viewtemplates)
# note: Zebra
if_ = Custom[Logic.If](test=contains, ifTrue=code_block_10, ifFalse=count)  # Retains the old status of the previous built-in IF node.
string_from_object = FromObject(obj=if_)

# group: True = delete unused filters. If false, we will feed through an empty list, which contains 0 items, so we do not need to process this list like the view templates node.
get_unused_filters = Python()  # unwired: IN[0]
# ---------- get_unused_filters.python (57 lines) ----------
import clr
clr.AddReference('ProtoGeometry')
from Autodesk.DesignScript.Geometry import *

clr.AddReference("System.Core")
import System.Linq
clr.ImportExtensions(System.Linq)

clr.AddReference("RevitAPI")
import Autodesk.Revit
from Autodesk.Revit.Exceptions import InvalidOperationException
from Autodesk.Revit.DB import *

# Import ToDSType(bool) extension method
clr.AddReference("RevitNodes")
import Revit
clr.ImportExtensions(Revit.Elements)

# Import DocumentManager
clr.AddReference("RevitServices")
import RevitServices
from RevitServices.Persistence import DocumentManager

def GetFilterIds(view):
  filterIds = None
  try:
    filterIds = view.GetFilters()
  except InvalidOperationException, e:
    filterIds = None
  return filterIds

def GetUsedFilterIds(doc):
  views = FilteredElementCollector(doc).OfClass(View).ToElements()
  usedFilterIds = []
  for view in views:
    viewFilterIds = []
    try:
      viewFilterIds = view.GetFilters()
    except InvalidOperationException, e:
      pass # this exception happens when a view doesn't support filters
    usedFilterIds.extend(viewFilterIds)
  return usedFilterIds

def GetUnusedFilters(doc):
  usedFilterIds = GetUsedFilterIds(doc).ToList[ElementId]()
  if len(usedFilterIds) > 0:
  	unusedFilters = FilteredElementCollector(doc).OfClass(ParameterFilterElement).Excluding(usedFilterIds).ToElements()
  else:
  	unusedFilters = FilteredElementCollector(doc).OfClass(ParameterFilterElement).ToElements()
  return list(f.ToDSType(True) for f in unusedFilters)

#The inputs to this node will be stored as a list in the IN variables.

doc = DocumentManager.Instance.CurrentDBDocument

#Assign your output to the OUT variable.
OUT = GetUnusedFilters(doc)
# ----------------------------------------
empty = List.Empty()
# note: Zebra
if_2 = Custom[Logic.If](test=code_block_8.out_Filtr, ifTrue=get_unused_filters, ifFalse=empty)
count_2 = List.Count(list=if_2)
string_from_object_2 = FromObject(obj=count_2)
# note: archilab
delete = archilab.Revit.Elements.Elements.Delete(element=if_2)

# group: True = delete line patterns. We haven't got a 'catch all' in this case, but you could add one similarly to the view templates pathway. The output of this node is typically a sentence, where the first word is the number of patterns deleted, so we find the first space, and get all characters before that as a sub-string for our results.
delete_linepatterns = Custom[Delete LinePatterns](Toggle=code_block_8.out_LPatn)  # Delete all the imported Line Patterns from CAD files.
code_block_11 = CodeBlock { 0; }
code_block_12 = CodeBlock { " "; true; }
indexOf = String.IndexOf(str=delete_linepatterns, searchFor=code_block_12.out0, ignoreCase=code_block_12.out1)
substring = String.Substring(str=delete_linepatterns, startIndex=code_block_11, length=indexOf)

# group: True = purge current document (fully). False = purge an empty list (no document). We also feed through our true or false as a string for our results.
string_from_object_3 = FromObject(obj=code_block_8.out_Purge)
current = Orchid.Revit.Core.Document.Current()
empty_2 = List.Empty()
# note: Zebra
if_3 = Custom[Logic.If](test=code_block_8.out_Purge, ifTrue=current, ifFalse=empty_2)
boolean_2 = BoolSelector(true)
# note: Orchid
purge = Orchid.Revit.Core.Document.Purge(document=if_3, completely=boolean_2)

# group: UI Buttons - not covered in the session (data shapes)
string = StringInput("Removed:;")
ui_textnote_data = Custom[UI.TextNote Data](Title=code_block.out0, TextNote_string_var=string_from_object)  # Create Data for TextNote input in UI.MultipleInputForm ++ . Check out www.data-shapes.net for more informations
ui_textnote_data_2 = Custom[UI.TextNote Data](Title=code_block.out1, TextNote_string_var=string_from_object_2)
ui_textnote_data_3 = Custom[UI.TextNote Data](Title=code_block.out2, TextNote_string_var=substring)
ui_textnote_data_4 = Custom[UI.TextNote Data](Title=code_block.out3, TextNote_string_var=string_from_object_3)
list_create_4 = List.Create(item0=ui_textnote_data, item1=ui_textnote_data_2, item2=ui_textnote_data_3, item3=ui_textnote_data_4)
ui_inputgroup_data_3 = Custom[UI.InputGroup Data](GroupTitle=string, Inputs=list_create_4)

code_block_13 = CodeBlock { "Working Views"; "Legends"; "Schedules"; }

# group: Get all Views
string_2 = StringInput("Views")
byName = Category.ByName(name=string_2)
all_elements_of_category = ElementsOfCategory(Category=byName)

# group: Remove 'Nulls'
isNull = Object.IsNull(obj=all_elements_of_category)
filterByBoolMask = List.FilterByBoolMask(list=all_elements_of_category, mask=isNull)

# group: Get View Type
string_3 = StringInput("Type")
getParameterValueByName = Element.GetParameterValueByName(element=filterByBoolMask.out, parameterName=string_3)
code_block_14 = CodeBlock { ""; }
eq = getParameterValueByName == code_block_14

# group: Filter view and view type for blank types
filterByBoolMask_2 = List.FilterByBoolMask(list=filterByBoolMask.out, mask=eq)
filterByBoolMask_3 = List.FilterByBoolMask(list=getParameterValueByName, mask=eq)

# group: Working view types
name = Element.Name(element=filterByBoolMask_3.out)
code_block_15 = CodeBlock { "working"; true; }
contains_2 = String.Contains(str=name, searchFor=code_block_15.out0, ignoreCase=code_block_15.out1)

# group: Working views, filtered by type mask
filterByBoolMask_4 = List.FilterByBoolMask(list=filterByBoolMask_2.out, mask=contains_2)

# group: Filter views for legends
string_4 = StringInput("Legend")
eq_2 = name == string_4
filterByBoolMask_5 = List.FilterByBoolMask(list=filterByBoolMask_2.out, mask=eq_2)

# group: Get all Schedules
string_5 = StringInput("Schedules")
byName_2 = Category.ByName(name=string_5)
all_elements_of_category_2 = ElementsOfCategory(Category=byName_2)

# group: True = allow through False = empty lists
empty_3 = List.Empty()
# note: Zebra (x3)
if_4 = Custom[Logic.If](test=code_block_8.out_WorkV, ifTrue=filterByBoolMask_4.in, ifFalse=empty_3)
if_5 = Custom[Logic.If](test=code_block_8.out_Legen, ifTrue=filterByBoolMask_5.in, ifFalse=empty_3)
if_6 = Custom[Logic.If](test=code_block_8.out_Sched, ifTrue=all_elements_of_category_2, ifFalse=empty_3)

# group: Get number of items from each, for results
count_3 = List.Count(list=if_4)
string_from_object_4 = FromObject(obj=count_3)
count_4 = List.Count(list=if_5)
string_from_object_5 = FromObject(obj=count_4)
count_5 = List.Count(list=if_6)
string_from_object_6 = FromObject(obj=count_5)

# group: UI Buttons - not covered in the session (data shapes)
string_6 = StringInput("Deleted:;")
ui_textnote_data_5 = Custom[UI.TextNote Data](Title=code_block_13.out0, TextNote_string_var=string_from_object_4)
ui_textnote_data_6 = Custom[UI.TextNote Data](Title=code_block_13.out1, TextNote_string_var=string_from_object_5)
ui_textnote_data_7 = Custom[UI.TextNote Data](Title=code_block_13.out2, TextNote_string_var=string_from_object_6)
list_create_5 = List.Create(item0=ui_textnote_data_5, item1=ui_textnote_data_6, item2=ui_textnote_data_7)
ui_inputgroup_data_4 = Custom[UI.InputGroup Data](GroupTitle=string_6, Inputs=list_create_5)

# group: UI - not covered in the session (data shapes)
code_block_16 = CodeBlock { "Results"; "Finished"; "Cancel"; }
file_path_2 = Filename(".\logo.jpg")
list_create_6 = List.Create(item0=ui_inputgroup_data_3, item1=ui_inputgroup_data_4)
boolean_3 = BoolSelector(true)
code_block_17 = CodeBlock { 1000; 300; }
ui_multipleinputform_2 = Custom[UI.MultipleInputForm ++](Description_optional=code_block_16.out0, Logo_optional=file_path_2, ButtonText_optional=code_block_16.out1, Inputs=list_create_6, Toggle=boolean_3, CancelButtonText_optional=code_block_16.out2, MaxHeight_optional=code_block_17.out0, Width_optional=code_block_17.out1)

# group: Delete what makes it through the 'If's
list_create_7 = List.Create(item0=if_4, item1=if_5, item2=if_6)
# note: archilab
delete_2 = archilab.Revit.Elements.Elements.Delete(element=list_create_7)
